% Simulink data dictionary VTOLDynamicsDataBak.sldd

ControlSampleTime = 0.005
FWTrimSpeed = 166.667
UAVSampleTime = 0.005
Vcruise = 16
Vt = 14

control = struct(
  turningRadius=60,
  L1=60,
  transitionRadius=60,
  minThrottle=0,
  maxThrottle=1,
  slewRateThrottle=1,
  slewRateServos=5,
  maxPitch=0.1745329,
  minPitch=-0.1745329,
  maxRoll=0.6981317,
  minRoll=-0.6981317,
  maxRollRate=1.22173,
  minRollRate=-1.22173,
  maxPitchRate=1.22173,
  minPitchRate=-1.22173,
  maxClimbRate=3,
  maxDescendRate=-3,
  stallSpeed=9.5,
  cruiseSpeed=20,
  takeoffSpeed=12.35,
  takeoffNavAlt=5,
  climboutAltMin=10,
  climboutAlt=13,
  landingApproachSpeed=12.35,
  flarePitch=0.03490659,
  flareAlt=2,
  landStopVel=1,
  finalLoiterSpeed=15)

tilt_trim = 0

uavParam_Works = struct(
  aero=struct(
    rho=1.225,
    CL0=0.81857,
    CLa=4.09127,
    CLa_dot=0,
    CLq=7.31097,
    CLDe=0.50787,
    CLDa=-0.85291,
    CDmin=0.06047,
    K=0.1328,
    CL_CDmin=0.4806,
    A1=0,
    CdDe=0.016043,
    CdDa=0.092132,
    CdDr=0.0097403,
    Cm0=0.00763,
    Cma=-1.76966,
    Cmq=-19.22663,
    CmDe=-1.83747,
    CYb=-0.00157,
    CYp=-0.00157,
    CYr=0.18368,
    CYDr=0.128915,
    Clb=-0.00161,
    Clp=-0.47584,
    Clr=0.27153,
    ClDa=0.286593,
    ClDr=0.013407,
    Cnb=0.0918,
    Cnp=-0.13267,
    Cnr=-0.08829,
    CnDa=0.0049274,
    CnDr=-0.067036,
    dragCoeffMov=0.027,
    g=9.806),
  geom=struct(
    b=2,
    AR=7.2727,
    c=0.275,
    e=0.986,
    RotorArm1=[0.375 0.375 0],
    RotorArm2=[0.375 -0.375 0],
    RotorArm3=[-0.375 -0.375 0],
    RotorArm4=[-0.375 0.375 0],
    Ixx=0.267,
    Iyy=0.267,
    Izz=0.375,
    mass=6.023,
    PropDiameter=0.3052),
  motor=struct(RPMMAX=10000, tilt_trim=0))

w_trim = 110.3898
windVel = [0 0 0]

doubleUavPathManager = Simulink.Bus()
  mode: uint8
  position: double[3 1]
  params: double[4 1]

innerLoopCmdsBus = Simulink.Bus()
  LAP: double[3]
  HeadingCmd: double
  YawCmd: double

FWControl = struct(transitionRadius=10)

GuidanceStates = Simulink.Bus()
  Euler: double[3]
  pqr: double[3]
  Ve: double[3]
  Xe: double[3]
  course: double
  Tilt: double

MaxTilt = 1.047198
TiltScheduleRate = 0.2617994
CriticalTiltAngle = 1.047198
WindDownRate = 20

env = struct(
  ISA_lapse=0.0065,
  ISA_hmax=2000,
  ISA_R=287.0531,
  ISA_g=9.80665,
  ISA_rho0=1.225,
  ISA_P0=101325,
  ISA_T0=288.15,
  windBase=12,
  windDirTurb=180,
  windDirHor=90,
  windOn=0)

FixedWingCtrlBus = Simulink.Bus()
  dA: double
  dE: double
  dR: double
  dT: double

RotorCtrlBus = Simulink.Bus()
  w1: double
  w2: double
  w3: double
  w4: double
  Tilt1: double
  Tilt2: double

px4_Bus_actuator_outputs = Simulink.Bus(HeaderFile="<uORB/topics/actuator_outputs.h>")  % px4_Bus_actuator_outputs
  timestamp: uint64
  noutputs: uint32
  output: single[1 16]
  _padding0: uint8[1 4]

px4_Bus_debug_array = Simulink.Bus(HeaderFile="<uORB/topics/debug_array.h>")  % px4_Bus_debug_array
  timestamp: uint64
  data: single[1 58]
  id: uint16
  name: uint8[1 10]
  _padding0: uint8[1 4]

px4_Bus_vehicle_odometry = Simulink.Bus(HeaderFile="<uORB/topics/vehicle_odometry.h>")  % px4_Bus_vehicle_odometry
  timestamp: uint64
  timestamp_sample: uint64
  position: single[1 3]
  q: single[1 4]
  velocity: single[1 3]
  angular_velocity: single[1 3]
  position_variance: single[1 3]
  orientation_variance: single[1 3]
  velocity_variance: single[1 3]
  pose_frame: uint8
  velocity_frame: uint8
  reset_counter: uint8
  quality: int8
  _padding0: uint8[1 4]

px4_Bus_actuator_armed = Simulink.Bus(HeaderFile="<uORB/topics/actuator_armed.h>")  % px4_Bus_actuator_armed
  timestamp: uint64
  armed: boolean
  prearmed: boolean
  ready_to_arm: boolean
  lockdown: boolean
  manual_lockdown: boolean
  force_failsafe: boolean
  in_esc_calibration_mode: boolean
  _padding0: uint8

px4_Bus_airspeed = Simulink.Bus(HeaderFile="<uORB/topics/airspeed.h>")  % px4_Bus_airspeed
  timestamp: uint64
  timestamp_sample: uint64
  indicated_airspeed_m_s: single
  true_airspeed_m_s: single
  air_temperature_celsius: single
  confidence: single

px4_Bus_vehicle_land_detected = Simulink.Bus(HeaderFile="<uORB/topics/vehicle_land_detected.h>")  % px4_Bus_vehicle_land_detected
  timestamp: uint64
  freefall: boolean
  ground_contact: boolean
  maybe_landed: boolean
  landed: boolean
  in_ground_effect: boolean
  in_descend: boolean
  has_low_throttle: boolean
  vertical_movement: boolean
  horizontal_movement: boolean
  rotational_movement: boolean
  close_to_ground_or_skipped_check: boolean
  at_rest: boolean
  _padding0: uint8[1 4]

px4_Bus_vehicle_attitude = Simulink.Bus(HeaderFile="<uORB/topics/vehicle_attitude.h>")  % px4_Bus_vehicle_attitude
  timestamp: uint64
  timestamp_sample: uint64
  q: single[1 4]
  delta_q_reset: single[1 4]
  quat_reset_counter: uint8
  _padding0: uint8[1 7]

px4_Bus_vehicle_local_position = Simulink.Bus(HeaderFile="<uORB/topics/vehicle_local_position.h>")  % px4_Bus_vehicle_local_position
  timestamp: uint64
  timestamp_sample: uint64
  ref_timestamp: uint64
  ref_lat: double
  ref_lon: double
  x: single
  y: single
  z: single
  delta_xy: single[1 2]
  delta_z: single
  vx: single
  vy: single
  vz: single
  z_deriv: single
  delta_vxy: single[1 2]
  delta_vz: single
  ax: single
  ay: single
  az: single
  heading: single
  delta_heading: single
  ref_alt: single
  dist_bottom: single
  eph: single
  epv: single
  evh: single
  evv: single
  vxy_max: single
  vz_max: single
  hagl_min: single
  hagl_max: single
  xy_valid: boolean
  z_valid: boolean
  v_xy_valid: boolean
  v_z_valid: boolean
  xy_reset_counter: uint8
  z_reset_counter: uint8
  vxy_reset_counter: uint8
  vz_reset_counter: uint8
  heading_reset_counter: uint8
  heading_good_for_control: boolean
  xy_global: boolean
  z_global: boolean
  dist_bottom_valid: boolean
  dist_bottom_sensor_bitfield: uint8
  dead_reckoning: boolean
  _padding0: uint8

px4_Bus_vehicle_global_position = Simulink.Bus(HeaderFile="<uORB/topics/vehicle_global_position.h>")  % px4_Bus_vehicle_global_position
  timestamp: uint64
  timestamp_sample: uint64
  lat: double
  lon: double
  alt: single
  alt_ellipsoid: single
  delta_alt: single
  eph: single
  epv: single
  terrain_alt: single
  lat_lon_reset_counter: uint8
  alt_reset_counter: uint8
  terrain_alt_valid: boolean
  dead_reckoning: boolean
  _padding0: uint8[1 4]

MAVLink_Input_Read_Size = 1024
DeploymentConfiguration = Simulink.ConfigSet(StartTime="0", StopTime="inf", Solver="FixedStepAuto", ProdHWDeviceType="ARM Compatible->ARM Cortex", SystemTargetFile="ert.tlc", HardwareBoard="PX4 Cube Orange+", TargetLang="C++")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
VTOLConfiguration = Simulink.ConfigSet(StartTime="0", StopTime="simTime", Solver="ode4", ProdHWDeviceType="Intel->x86-64 (Windows64)", SystemTargetFile="ert.tlc", TargetLang="C")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
VTOLConfigurationBak = Simulink.ConfigSet(StartTime="0", StopTime="simTime", RelTol="1e-3", Solver="VariableStepAuto", ProdHWDeviceType="Intel->x86-64 (Windows64)", SystemTargetFile="ert.tlc", TargetLang="C")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
Sig = Simulink.Signal()

stateBus = Simulink.Bus()
  course: double
  gndspeed: double
  airspeed: double
  Xe: double[3 1]
  Ve: double[3 1]
  DCMbe: double[3 3]
  q: double[1 4]
  pqr: double[3 1]
  Vb: double[1 3]
  Abb: double[1 3]
  Abe: double[1 3]
  Euler: double[3 1]
  RotorParameters: Bus: RotorCtrlBus
  ypr: double[3 1]
  Ve_ground: double[3 1]
  aoa: double
  aos: double
  aileron: double
  elevator: double
  rudder: double

simTime = 80